# Grasshopper definition 20231220_objWriter.gh (Grasshopper 1.0.7)
# plug-ins: LunchBox

mesh = Mesh([<mesh referenced from the Rhino model> x15])
excelread = ExcelReaderLEGACY(ReadToggle=<missing>, Worksheet=1, Column=<missing>, RowStart=1, RowEnd=<missing>)  # -> Exceptions, ExcelData
excelread_2 = ExcelReaderLEGACY(ReadToggle=<missing>, Worksheet=1, Column=<missing>, RowStart=1, RowEnd=<missing>)  # -> Exceptions, ExcelData
id = Guid(mesh)
python = GhPythonScript(guid=id)  # -> out, full_name; inputs guid: Guid
# ---------- python: Python ----------
__author__ = "yang"

import rhinoscriptsyntax as rs
import scriptcontext as sc
import Rhino

sc.doc = Rhino.RhinoDoc.ActiveDoc
obj = sc.doc.Objects.Find(guid)
layer_index = obj.Attributes.LayerIndex
full_name = sc.doc.Layers[layer_index].FullPath
print(full_name)
sc.doc = ghdoc
# ---------- end python ----------
path = FilePath("/Users/yang/DriveDBT/20230922_Innovedum/1105/name.obj")
panel = Panel(python.full_name)
c_script = CSharpScript(in_run=Button(), in_mesh=graft(mesh), in_name=graft(python.full_name), in_path=path)  # -> out, A; inputs in_run: Boolean, in_mesh: list of Mesh, in_name: String, in_path: String
# ---------- c_script: C# ----------
    if(in_run) {
      path = System.IO.Path.GetDirectoryName(in_path) + "\\" + in_name + ".obj";
      int faceCount = 0;
      using(StreamWriter writer = new StreamWriter(path)) {
        for(int n = 0; n < in_mesh.Count; n++) {
          List<String> vert = new List<String>();
          List<String> face = new List<String>();

          in_mesh[n].Faces.ConvertQuadsToTriangles();
          BoundingBox bbox = in_mesh[n].GetBoundingBox(true);

          for(int i = 0; i < in_mesh[n].Vertices.Count; i++) {
            vert.Add(String.Format("v {0} {1} {2}", -in_mesh[n].Vertices[i].X, in_mesh[n].Vertices[i].Z, in_mesh[n].Vertices[i].Y));
          }

          for(int i = 0; i < in_mesh[n].TextureCoordinates.Count; i++) {
            double tx = in_mesh[n].TextureCoordinates[i].X;
            double ty = in_mesh[n].TextureCoordinates[i].Y;
            vert.Add(String.Format("vt " + tx.ToString("F6") + " " + ty.ToString("F6")));
          }

          for(int i = 0; i < in_mesh[n].Normals.Count; i++) {
            vert.Add(String.Format("vn {0} {1} {2}", -in_mesh[n].Normals[i].X, in_mesh[n].Normals[i].Z, in_mesh[n].Normals[i].Y));
          }

          for(int i = 0; i < in_mesh[n].Faces.Count; i++) {
            MeshFace f = in_mesh[n].Faces.GetFace(i);
            int fa = f.A + 1 + faceCount;
            int fb = f.B + 1 + faceCount;
            int fc = f.C + 1 + faceCount;
            string fas = fa.ToString();
            string fbs = fb.ToString();
            string fcs = fc.ToString();
            face.Add(String.Format("f " + fas + "/" + fas + "/" + fas + " " + fbs + "/" + fbs + "/" + fbs + " " + fcs + "/" + fcs + "/" + fcs));
          }

          for(int i = 0; i < vert.Count; i++) {
            writer.WriteLine(vert[i]);
          }

          writer.WriteLine("");
          writer.WriteLine("g " + in_name + n.ToString());

          for(int i = 0; i < face.Count; i++) {
            writer.WriteLine(face[i]);
          }
          faceCount += in_mesh[n].Vertices.Count;
        }
      }
    }
    A = path;
# ---------- c_script: C# additional code ----------
  String path;
# ---------- end c_script ----------
