# Grasshopper definition objWriter_wen.gh (Grasshopper 1.0.7)
# plug-ins: Human, LunchBox

panel = Panel("C:\Users\Wenqian\Desktop\2021_HoloLens\20211022_arexphitibion\columns_task1_2021-11-01\obj")

# ---- group: generate 300 columns and export obj
number_slider = Slider(300, range=0..300)
number_slider_2 = Slider(10, range=0..10)
panel_2 = Panel("C:\Users\Wenqian\Desktop\2021_HoloLens\20211022_arexphitibion\300tower\test.obj")
random = Random(Range="0.0 to 2.0", Number=number_slider_2, Seed=number_slider)
random_2 = Random(Range="0.3 to 1.0", Number=number_slider_2, Seed=number_slider)
random_3 = Random(Range="3 to 15", Number=1, Seed=number_slider)
xy = XYPlane(Origin=Point(0, 0, 0))
int = Integer(random_3)
division = Division(A=3.6, B=number_slider_2)
polygon = Polygon(Plane=xy, Radius=Slider(0.3, range=0..1), Segments=int, FilletRadius=0)  # -> Polygon, Length
series = Series(Start=0, Step=division, Count=expr("x+1", number_slider_2))
flip = FlipCurve(Curve=polygon.Polygon)  # -> Curve, Flag
path = FilePath(panel_2)
Z = UnitZ(Factor=series)
move = Move(Geometry=flip.Curve, Motion=Z)  # -> Geometry, Transform
area = Area(Geometry=move.Geometry)  # -> Area, Centroid
scale = Scale(Geometry=move.Geometry, Center=area.Centroid, Factor=random_2)  # -> Geometry, Transform
pi = Pi(Factor=random)
rotate = Rotate(Geometry=scale.Geometry, Angle=pi, Plane=PlaneXY(0, 0, 0))  # -> Geometry, Transform
loft = Loft(Curves=rotate.Geometry, Options={Adjust=False, Closed=False, LoftEnds=0, LoftSimp=0, LoftType=3, Rebuild=10, Refit=0.01})
mesh = Mesh(loft)
rec = DataRecorder(mesh, DataLimit=-10, RecordData=True)
lng = ListLength(List=rec)
series_2 = Series(Start=0, Step=1, Count=lng)
panel_3 = Panel(lng)
c_script = CSharpScript(in_run=Button(), in_mesh=graft(rec), in_name=graft(series_2), in_path=path)  # -> out, A; inputs in_run: Boolean, in_mesh: list of Mesh, in_name: String, in_path: String
# ---------- c_script: C# ----------
    if(in_run) {
      path = System.IO.Path.GetDirectoryName(in_path) + "\\" + in_name + ".obj";
      int faceCount = 0;
      using(StreamWriter writer = new StreamWriter(path)) {
        for(int n = 0; n < in_mesh.Count; n++) {
          List<String> vert = new List<String>();
          List<String> face = new List<String>();

          in_mesh[n].Faces.ConvertQuadsToTriangles();
          BoundingBox bbox = in_mesh[n].GetBoundingBox(true);

          for(int i = 0; i < in_mesh[n].Vertices.Count; i++) {
            vert.Add(String.Format("v {0} {1} {2}", -in_mesh[n].Vertices[i].X, in_mesh[n].Vertices[i].Z, in_mesh[n].Vertices[i].Y));
          }

          for(int i = 0; i < in_mesh[n].TextureCoordinates.Count; i++) {
            double tx = in_mesh[n].TextureCoordinates[i].X;
            double ty = in_mesh[n].TextureCoordinates[i].Y;
            vert.Add(String.Format("vt " + tx.ToString("F6") + " " + ty.ToString("F6")));
          }

          for(int i = 0; i < in_mesh[n].Normals.Count; i++) {
            vert.Add(String.Format("vn {0} {1} {2}", -in_mesh[n].Normals[i].X, in_mesh[n].Normals[i].Z, in_mesh[n].Normals[i].Y));
          }

          for(int i = 0; i < in_mesh[n].Faces.Count; i++) {
            MeshFace f = in_mesh[n].Faces.GetFace(i);
            int fa = f.A + 1 + faceCount;
            int fb = f.B + 1 + faceCount;
            int fc = f.C + 1 + faceCount;
            string fas = fa.ToString();
            string fbs = fb.ToString();
            string fcs = fc.ToString();
            face.Add(String.Format("f " + fas + "/" + fas + "/" + fas + " " + fbs + "/" + fbs + "/" + fbs + " " + fcs + "/" + fcs + "/" + fcs));
          }

          for(int i = 0; i < vert.Count; i++) {
            writer.WriteLine(vert[i]);
          }

          writer.WriteLine("");
          writer.WriteLine("g " + in_name + n.ToString());

          for(int i = 0; i < face.Count; i++) {
            writer.WriteLine(face[i]);
          }
          faceCount += in_mesh[n].Vertices.Count;
        }
      }
    }
    A = path;
# ---------- c_script: C# additional code ----------
  String path;
# ---------- end c_script ----------

# ----
toggle = BooleanToggle(True)

# ---- group: obj name
dir = DirectoryContents(FolderPath=panel, IncludeSubfolders=False)  # -> FilePaths, FileNames

# ----
number_slider_3 = Slider(294, range=0..310)
item = ListItem(Index=Slider(3, range=0..10), Wrap=True)
_3dm = Import3DM(File=dir.FilePaths, Layer="*", Name="*")
split = TextSplit(Text=dir.FilePaths, Separators="\")
excelread = ExcelReaderLEGACY(ReadToggle=toggle, Worksheet=1, Column=Slider(3, range=0..100), RowStart=1, RowEnd=number_slider_3)  # -> Exceptions, ExcelData
excelread_2 = ExcelReaderLEGACY(ReadToggle=toggle, Worksheet=1, Column=Slider(5, range=0..100), RowStart=1, RowEnd=number_slider_3)  # -> Exceptions, ExcelData
item_2 = ListItem(List=dir.FilePaths, Index=Slider(42, range=0..100), Wrap=True)
item_3 = ListItem(List=split, Index=-1, Wrap=True)
sortbytype = SortObjectsByType(RhinoObjects=_3dm)  # -> Points, Curves, Surfaces, Breps, Meshes, TextObjects, HatchObjects, LightObjects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
flip_2 = FlipMatrix()
split_2 = TextSplit(Text=excelread_2.ExcelData, Separators="/")
item_4 = ListItem(List=sortbytype.Meshes, Index=0, Wrap=True)  # -> flatten(Item)
data = Data(flatten(item_3))

# ---- group: obj names from excel
item_5 = ListItem(List=split_2, Index=-1, Wrap=True)  # -> flatten(Item)

# ----
item_6 = ListItem(List=dir.FilePaths, Index=Slider(20, range=0..100), Wrap=True)
lng_2 = ListLength(List=data)
item_7 = ListItem(List=item_4, Index=Slider(239, range=0..256), Wrap=True)
tmatch = MatchText(Text=item_5, Pattern=item_3, Case=True)
series_3 = Series(Start=0, Step=1, Count=number_slider_3)
series_4 = Series(Start=0, Step=1, Count=lng_2)
cull = CullPattern(List=series_3, CullPattern=tmatch)
item_8 = ListItem(List=item_5, Index=cull, Wrap=True)  # -> flatten(Item)
tmatch_2 = MatchText(Text=data, Pattern=graft(item_8), Case=True)
cull_2 = CullPattern(List=series_4, CullPattern=tmatch_2)  # -> flatten(List)
sort = SortList(Keys=flatten(cull))  # -> Keys, ValuesA
item_9 = ListItem(List=excelread.ExcelData, Index=cull, Wrap=True)  # -> flatten(Item)
item_10 = ListItem(List=item_4, Index=cull_2, Wrap=True)
yz = YZPlane(Origin=Point(0, 0, 0))

# ---- group: mesh
rotate_2 = Rotate(Geometry=item_10, Angle=1.570796327, Plane=yz)  # -> Geometry, Transform

# ----
panel_4 = Panel(rotate_2.Geometry)
bbox = BoundingBox(Content=rotate_2.Geometry, Plane=PlaneXY(0, 0, 0))  # -> Box, Box_2
boxprop = BoxProperties(Box=bbox.Box)  # -> Center, Diagonal, Area, Volume, Degeneracy
panel_5 = Panel("C:\Users\Wenqian\Desktop\2021_HoloLens\20211022_arexphitibion\columns_task1_2021-11-01\obj_fixed\test.obj")
debox = DeconstructBox(Box=bbox.Box)  # -> Plane, X, Y, Z
python = GhPythonScript(x=debox.Z)  # -> out, a
# ---------- python: Python ----------
__author__ = "Wenqian"
__version__ = "2021.10.31"

import rhinoscriptsyntax as rs


if x > 400:
    a = 0.001
elif x < 400 and x >40:
    a = 0.01
elif x < 40 and x >30:
    a = 0.1
else:
    a = 1
# ---------- end python ----------
concat = Concatenate(FragmentA="c:/", FragmentB=item_9, FragmentC=".obj")
sort_2 = SortList(Keys=debox.Z)  # -> Keys, ValuesA
panel_6 = Panel(sort_2.Keys)
scale_2 = Scale(Geometry=rotate_2.Geometry, Center=Point(0, 0, 0), Factor=python.a)  # -> Geometry, Transform
panel_7 = Panel(concat)
item_11 = ListItem(List=sort_2.ValuesA, Index=Slider(0, range=0..20), Wrap=True)
panel_8 = Panel(python.a)
bbox_2 = BoundingBox(Content=scale_2.Geometry, Plane=PlaneXY(0, 0, 0))  # -> Box, Box_2
lng_3 = ListLength(List=item_9)
debrep = DeconstructBrep(Brep=bbox_2.Box)  # -> Faces, Edges, Vertices
panel_9 = Panel(sort_2.ValuesA)
debox_2 = DeconstructBox(Box=bbox_2.Box)  # -> Plane, X, Y, Z
panel_10 = Panel(lng_3)
path_2 = FilePath(panel_5)
item_12 = ListItem(List=debrep.Faces, Index=Slider(4, range=0..4), Wrap=True)
sort_3 = SortList(Keys=debox_2.Z, ValuesA=debox_2.Z)  # -> Keys, ValuesA
area_2 = Area(Geometry=item_12)  # -> Area, Centroid
pt = Point(Point(0, 0, 0))
vec2pt = Vector2Pt(PointA=area_2.Centroid, PointB=pt, Unitize=False)  # -> flatten(Vector), Length
panel_11 = Panel(sort_3.Keys)
move_2 = Move(Geometry=scale_2.Geometry, Motion=vec2pt.Vector)  # -> Geometry, Transform
mesh_2 = Mesh(move_2.Geometry)
lng_4 = ListLength(List=mesh_2)
panel_12 = Panel(lng_4)
c_script_2 = CSharpScript(in_run=Button(), in_mesh=graft(mesh_2), in_name=graft(item_9), in_path=path_2)  # -> out, A; inputs in_run: Boolean, in_mesh: list of Mesh, in_name: String, in_path: String; same code as c_script
panel_13 = Panel(move_2.Geometry)
