# Grasshopper definition writeLinesToJson.gh (Grasshopper 1.0.7)
# plug-ins: NGon

# ---- group: Reference text objects from Rhino
id = Guid(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)

# ----
crv = Curve([<curve referenced from the Rhino model> x4])
id_2 = Guid(crv)
c_script = CSharpScript(id=id)  # -> out, text, plane; inputs id: Guid
# ---------- c_script: C# usings ----------
using System.IO;
using System.Linq;
using System.Data;
using System.Drawing;
using System.Reflection;
using System.Windows.Forms;
using System.Xml;
using System.Xml.Linq;
using System.Runtime.InteropServices;

using Rhino.DocObjects;
using Rhino.Collections;
using GH_IO;
using GH_IO.Serialization;
# ---------- c_script: C# ----------
    RhinoObject ro = RhinoDocument.Objects.Find(id);

    if(ro.ObjectType != ObjectType.Annotation) return;

    TextObject txt = ro as TextObject;

    text = txt.TextGeometry.Text;
    plane = txt.TextGeometry.Plane;
# ---------- end c_script ----------
python = GhPythonScript(
    lines=crv,
    writeJson=Button(),
    fileName="arrow_force_internal_beam.json",
    address="/Users/yang/GitHub/20231106_Innovedum/OnlineResources/json")  # -> out, a; inputs lines: list of Line, writeJson: Boolean
# ---------- python: Python ----------
__author__ = "yang"

import rhinoscriptsyntax as rs
import Rhino.Geometry as rg
import json
import os

if writeJson:
    
    jsonContent = []
    for i in range(len(lines)):
        jsonContent.append(
        [[lines[i].PointAt(0).X,
        lines[i].PointAt(0).Y,
        lines[i].PointAt(0).Z],
        [lines[i].PointAt(1).X,
        lines[i].PointAt(1).Y,
        lines[i].PointAt(1).Z]]
        )
    jsonContent = {"lines": jsonContent}
    jsonObj = json.dumps(jsonContent, indent=4)
    
    path = os.path.join(address, fileName)
    
    with open(path, "w") as outFile:
        outFile.write(jsonObj)
# ---------- end python ----------
panel = Panel(c_script.text)
panel_2 = Panel(c_script.plane)
panel_3 = Panel(python.out)
number_slider = Slider(0.01, range=0..0.1)
python_2 = GhPythonScript(
    text=c_script.text,
    location=c_script.plane,
    writeJson=Button(),
    fileName="4.json",
    address="/Users/yang/GitHub/webServer/torsion/json")  # -> out, a; inputs location: Point3d, writeJson: Boolean
# ---------- python_2: Python ----------
__author__ = "yang"

import rhinoscriptsyntax as rs
import Rhino.Geometry as rg
import json
import os

if writeJson:
    
    jsonContent = {
    "text":text,
    "pt":[location.X, location.Y, location.Z]}
    
    jsonObj = json.dumps(jsonContent, indent=4)
    
    path = os.path.join(address, fileName)
    
    with open(path, "w") as outFile:
        outFile.write(jsonObj)
# ---------- end python_2 ----------
crv_2 = Curve([<curve referenced from the Rhino model> x8])
meshpipe = MeshPipe(Curve=crv_2, Radius=Slider(0.006, range=0..0.01), Sides=Slider(4, range=0..10), Tolerance=10, Ending=3)
